# Grasshopper definition 02_analiza_vizibilitate_punct_2025.gh (Grasshopper 1.0.7)
# plug-ins: EleFront, DeCodingSpaces, Pufferfish, eleFront

# ----
# Analiză vizibilitate într-un singur punct
# 
# Analiza vizibilitate în plan
# dintr-un singur punct fix.
# 
# Script dezvoltat în cadrul proiectului
# SCHOLAR ARCHITECT 2024
# Proiect finațat prin CNFIS-FDI-2024-F-0032.
# Autori: Ionuț Anton și Ana Daniela Anton
pipeline = GeometryPipeline(
    GroupByLayer=False,
    GroupByType=False,
    IncludeHidden=True,
    IncludeLocked=True,
    LayerFilter="propunere::Constructii",
    NameFilter="*",
    SublayerFiltering=True,
    TypeFilter=4)
pipeline_2 = GeometryPipeline(
    GroupByLayer=False,
    GroupByType=False,
    IncludeHidden=True,
    IncludeLocked=True,
    LayerFilter="urbanism::Constructii",
    NameFilter="*",
    SublayerFiltering=True,
    TypeFilter=4)
pipeline_3 = GeometryPipeline(
    GroupByLayer=False,
    GroupByType=False,
    IncludeHidden=True,
    IncludeLocked=True,
    LayerFilter="analiza::contur limita analiza",
    NameFilter="*",
    SublayerFiltering=True,
    TypeFilter=4)
pipeline_4 = GeometryPipeline(
    GroupByLayer=False,
    GroupByType=False,
    IncludeHidden=True,
    IncludeLocked=True,
    LayerFilter="analiza::vizibilitate::punct",
    NameFilter="*",
    SublayerFiltering=True,
    TypeFilter=1)

# ---- group: Click aici pentru bake in rhino
button = Button()

# ----
trigger = Trigger(Interval=60000, TimerInterval=60000, Target=time)
time = Time("now")
format = Format(Format="{0:yyyy-MM-dd-HH-mm-ss}", Culture=127, Data0=time)
concat = Concatenate(FragmentA="analiza_out::vizibilitate_punct::", FragmentB=format)
concat_2 = Concatenate(FragmentA=concat, FragmentB="::analiza")
layer = DefineLayer(Name=concat_2)

contur_limita_analiza = Curve(pipeline_3)
punct_vizibilitate = Point(pipeline_4)
propunere = Curve(pipeline)
constructii = Curve(pipeline_2)
merge = Merge(Data1=constructii, Data2=contur_limita_analiza, Data3=propunere)
explode = Explode(Curve=merge, Recursive=True)  # -> flatten(Segments), Vertices
isovist = Isovist(
    VantagePointS=punct_vizibilitate,
    ObstacleLines=explode.Segments,
    ViewingDirection=Vector(0, 1, 0),
    ViewingRange=1000,
    ViewingAngle=360,
    Precision=360,
    ShowPolygon=True,
    ShowRadials=Toggle(True),
    UseGPU=Toggle(True))  # -> IsovistPolygon, Radials, ObstacleVisibility, IsovistProperties
equals = Equality(FirstNumber="0", SecondNumber=isovist.ObstacleVisibility)  # -> Equality, Inequality
not = GateNot(A=equals.Equality)
cull = CullPattern(List=explode.Segments, CullPattern=not)
lng = ListLength(List=constructii)
midpt = CurveMiddle(Curve=cull)
series = Series(Start=0, Step=1, Count=lng)
cir = Circle(Plane=punct_vizibilitate, Radius=Slider(2.5, range=0..10))

hatch = DefineHatch(Curve=constructii, Pattern="Solid", Rotation=0, Scale=1)
dehatch = DeconstructHatch(Hatch=hatch)  # -> HatchGeometry, Boundary, Name, Scale, Rotation
hatch_2 = DefineHatch(Curve=isovist.IsovistPolygon, Pattern="Solid", Rotation=0, Scale=1)

incurves = PointInCurves(Point=midpt, Curves=dehatch.HatchGeometry)  # -> Relationship, Index, Point
cset = CreateSet(List=incurves.Index)  # -> Set, Map
cull_i = CullIndex(List=series, Indices=cset.Set, Wrap=True)
item = ListItem(List=dehatch.HatchGeometry, Index=cset.Set, Wrap=True)
item_2 = ListItem(List=hatch, Index=cull_i, Wrap=True)
item_3 = ListItem(List=hatch, Index=cset.Set, Wrap=True)
area = Area(Geometry=item)  # -> Area, Centroid
dist = Distance(PointA=area.Centroid, PointB=punct_vizibilitate)
bnd = Bounds(Numbers=dist)
remap = RemapNumbers(Value=dist, Source=bnd, Target=Domain(0, 1))  # -> Mapped, Clipped
gradient = Gradient(
    LowerLimit=0,
    UpperLimit=1,
    Parameter=remap.Mapped,
    stops=[0: RGB(255, 0, 0), 0.5: RGB(255, 136, 0), 1: RGB(255, 247, 0)])

hatch_3 = DefineHatch(Curve=cir, Pattern="Solid", Rotation=0, Scale=1)

lng_2 = ListLength(List=item_2)
lng_3 = ListLength(List=hatch_2)
dup = DuplicateData(Data=ColourSwatch(SwatchColor=RGB(133, 133, 133)), Number=lng_2, Order=True)
dup_2 = DuplicateData(Data=ColourSwatch(SwatchColor=RGB(0, 98, 255)), Number=lng_3, Order=True)
merge_2 = Merge(
    Data1=flatten(dup),
    Data2=flatten(dup_2),
    Data3=flatten(gradient),
    Data4=flatten(ColourSwatch(SwatchColor=RGB(255, 255, 255))))
merge_3 = Merge(Data1=flatten(item_2), Data2=flatten(hatch_2), Data3=flatten(item_3), Data4=flatten(hatch_3))
attributes = DefineObjectAttributes(Layer=layer, Color=merge_2)

bbox = BoundingBox(Content=contur_limita_analiza, Plane=PlaneXY(0, 0, 0))  # -> Box, Box_2
evalsrf = EvaluateSurface(Surface=reparameterize(bbox.Box), Point="{1,0,0}")  # -> Point, Normal, UDirection, VDirection, Frame
Y = UnitY(Factor="-100")
move = Move(Geometry=evalsrf.Point, Motion=Y)  # -> Geometry, Transform
list = ValueList({"Default", "Legenda"}, selected="Legenda")
range = Range(Domain=bnd, Steps=expr("x-1", "5"))
range_2 = Range(Domain=Domain(0, 1), Steps=expr("x-1", "5"))
sqgrid = Square(Plane=move.Geometry, Size=Slider(50, range=0..100), ExtentX="5", ExtentY="1")  # -> Cells, Points
text = DefineTextObject(Text="vizibilitate_punct", Plane=evalsrf.Point, DimensionStyle=list, OutputType="Text")
swatch = ColourSwatch(SwatchColor=RGB(0, 0, 0))
area_2 = Area(Geometry=flatten(sqgrid.Cells))  # -> Area, Centroid
roundd = RoundToDecimalPlace(NumberX=range, DecimalPlace=0, RoundType=0)  # -> Rounded, Difference
concat_3 = Concatenate(FragmentA=concat, FragmentB="::legenda")
Y_2 = UnitY(Factor="-30")
gradient_2 = Gradient(LowerLimit=0, UpperLimit=1, Parameter=range_2, stops=[0: RGB(255, 0, 0), 0.5: RGB(255, 136, 0), 1: RGB(255, 247, 0)])
layer_2 = DefineLayer(Name=concat_3)
move_2 = Move(Geometry=area_2.Centroid, Motion=Y_2)  # -> Geometry, Transform
text_2 = DefineTextObject(Text=roundd.Rounded, Plane=move_2.Geometry, DimensionStyle="Legenda_numere", OutputType="Text")
lng_4 = ListLength(List=text_2)
dup_3 = DuplicateData(Data=swatch, Number=lng_4, Order=True)
attributes_2 = DefineObjectAttributes(Layer=layer_2, Color=gradient_2)
attributes_3 = DefineObjectAttributes(Layer=layer_2, Color=dup_3)
attributes_4 = DefineObjectAttributes(Layer=layer_2, Color=swatch)
merge_4 = Merge(Data1=flatten(attributes), Data2=flatten(attributes_4), Data3=flatten(attributes_3), Data4=flatten(attributes_2))

hatch_4 = DefineHatch(Curve=sqgrid.Cells, Pattern="Solid", Rotation=0, Scale=1)

merge_5 = Merge(Data1=flatten(merge_3), Data2=flatten(text), Data3=flatten(text_2), Data4=flatten(hatch_4))

deatt = DeconstructAttributes(ReferencedGeometryOrAttributes=merge_4)  # -> Keys, Values, Name, Layer, Color
bake = BakeObjects(Geometry=merge_5, Attributes=merge_4, Bake=button)
material = CreateMaterial(Diffuse=deatt.Color, Specular=RGB(255, 255, 255), Emission=RGB(0, 0, 0), Transparency=0, Shine=0)
preview = CustomPreview(Geometry=merge_5, Shader=flatten(material))
