# Grasshopper definition 03_analiza_vizibilitate_curba_2025.gh (Grasshopper 1.0.7)
# plug-ins: EleFront, DeCodingSpaces

# ---- group: selecteaza punctul pe curba
punct_pe_curba = Slider(0.29, range=0..1)

# ----
# Analiză vizibilitate cu un punct pe o curbă
# 
# Analiza vizibilitate în plan
# într-un punct pe o curbă.
# 
# Script dezvoltat în cadrul proiectului
# SCHOLAR ARCHITECT 2024
# Proiect finațat prin CNFIS-FDI-2024-F-0032.
# Autori: Ionuț Anton și Ana Daniela Anton
pipeline = GeometryPipeline(
    GroupByLayer=False,
    GroupByType=False,
    IncludeHidden=True,
    IncludeLocked=True,
    LayerFilter="propunere::Constructii",
    NameFilter="*",
    SublayerFiltering=True,
    TypeFilter=4)
pipeline_2 = GeometryPipeline(
    GroupByLayer=False,
    GroupByType=False,
    IncludeHidden=True,
    IncludeLocked=True,
    LayerFilter="urbanism::Constructii",
    NameFilter="*",
    SublayerFiltering=True,
    TypeFilter=4)
pipeline_3 = GeometryPipeline(
    GroupByLayer=False,
    GroupByType=False,
    IncludeHidden=True,
    IncludeLocked=True,
    LayerFilter="analiza::contur limita analiza",
    NameFilter="*",
    SublayerFiltering=True,
    TypeFilter=4)
pipeline_4 = GeometryPipeline(
    GroupByLayer=False,
    GroupByType=False,
    IncludeHidden=True,
    IncludeLocked=True,
    LayerFilter="analiza::vizibilitate::curba",
    NameFilter="*",
    SublayerFiltering=True,
    TypeFilter=4)

# ---- group: Click aici pentru bake in rhino
button = Button()

# ----
trigger = Trigger(Interval=60000, TimerInterval=60000, Target=time)
time = Time("now")
format = Format(Format="{0:yyyy-MM-dd-HH-mm-ss}", Culture=127, Data0=time)
concat = Concatenate(FragmentA="analiza_out::vizibilitate_curba::", FragmentB=format)
concat_2 = Concatenate(FragmentA=concat, FragmentB="::analiza")
layer = DefineLayer(Name=concat_2)

crv = Curve(pipeline)
crv_2 = Curve(pipeline_2)
crv_3 = Curve(pipeline_4)
crv_4 = Curve(pipeline_3)
merge = Merge(Data1=crv_2, Data2=crv_4, Data3=crv)
eval = EvaluateCurve(Curve=reparameterize(crv_3), Parameter=punct_pe_curba)  # -> Point, Tangent, Angle
pt = Point(eval.Point)
explode = Explode(Curve=merge, Recursive=True)  # -> flatten(Segments), Vertices
isovist = Isovist(
    VantagePointS=pt,
    ObstacleLines=explode.Segments,
    ViewingDirection=Vector(0, 1, 0),
    ViewingRange=1000,
    ViewingAngle=360,
    Precision=360,
    ShowPolygon=True,
    ShowRadials=Toggle(False),
    UseGPU=Toggle(False))  # -> IsovistPolygon, Radials, ObstacleVisibility, IsovistProperties
equals = Equality(FirstNumber="0", SecondNumber=isovist.ObstacleVisibility)  # -> Equality, Inequality
not = GateNot(A=equals.Equality)
hatch = DefineHatch(Curve=crv_2, Pattern="Solid", Rotation=0, Scale=1)
cull = CullPattern(List=explode.Segments, CullPattern=not)
lng = ListLength(List=crv_2)
hatch_2 = DefineHatch(Curve=isovist.IsovistPolygon, Pattern="Solid", Rotation=0, Scale=1)
midpt = CurveMiddle(Curve=cull)
dehatch = DeconstructHatch(Hatch=hatch)  # -> flatten(HatchGeometry), flatten(Boundary), Name, Scale, Rotation
series = Series(Start=0, Step=1, Count=lng)
incurves = PointInCurves(Point=midpt, Curves=dehatch.Boundary)  # -> Relationship, Index, Point
cset = CreateSet(List=incurves.Index)  # -> Set, Map
cull_i = CullIndex(List=series, Indices=cset.Set, Wrap=True)
item = ListItem(List=dehatch.Boundary, Index=cset.Set, Wrap=True)
item_2 = ListItem(List=hatch, Index=cull_i, Wrap=True)
item_3 = ListItem(List=hatch, Index=cset.Set, Wrap=True)
area = Area(Geometry=item)  # -> Area, Centroid
cir = Circle(Plane=pt, Radius=Slider(2.5, range=0..10))
hatch_3 = DefineHatch(Curve=cir, Pattern="Solid", Rotation=0, Scale=1)

area_2 = Area(Geometry=item)  # -> Area, Centroid

dist = Distance(PointA=area_2.Centroid, PointB=pt)
bnd = Bounds(Numbers=dist)
remap = RemapNumbers(Value=dist, Source=bnd, Target=Domain(0, 1))  # -> Mapped, Clipped
gradient = Gradient(
    LowerLimit=0,
    UpperLimit=1,
    Parameter=remap.Mapped,
    stops=[0: RGB(255, 0, 0), 0.5: RGB(255, 136, 0), 1: RGB(255, 247, 0)])

lng_2 = ListLength(List=item_2)
lng_3 = ListLength(List=hatch_2)
dup = DuplicateData(Data=ColourSwatch(SwatchColor=RGB(133, 133, 133)), Number=lng_2, Order=True)
dup_2 = DuplicateData(Data=ColourSwatch(SwatchColor=RGB(0, 98, 255)), Number=lng_3, Order=True)
merge_2 = Merge(
    Data1=flatten(dup),
    Data2=flatten(dup_2),
    Data3=flatten(gradient),
    Data4=flatten(ColourSwatch(SwatchColor=RGB(255, 255, 255))))
merge_3 = Merge(Data1=flatten(item_2), Data2=flatten(hatch_2), Data3=flatten(item_3), Data4=flatten(hatch_3))
attributes = DefineObjectAttributes(Layer=layer, Color=merge_2)

bbox = BoundingBox(Content=crv_4, Plane=PlaneXY(0, 0, 0))  # -> Box, Box_2
evalsrf = EvaluateSurface(Surface=reparameterize(bbox.Box), Point="{1,0,0}")  # -> Point, Normal, UDirection, VDirection, Frame
Y = UnitY(Factor="-100")
move = Move(Geometry=evalsrf.Point, Motion=Y)  # -> Geometry, Transform
list = ValueList({"Default", "Legenda"}, selected="Legenda")
range = Range(Domain=bnd, Steps=expr("x-1", "5"))
range_2 = Range(Domain=Domain(0, 1), Steps=expr("x-1", "5"))
sqgrid = Square(Plane=move.Geometry, Size=Slider(50, range=0..100), ExtentX="5", ExtentY="1")  # -> Cells, Points
text = DefineTextObject(Text="vizibilitate_punct_pe_curba", Plane=evalsrf.Point, DimensionStyle=list, OutputType="Text")
gradient_2 = Gradient(LowerLimit=0, UpperLimit=1, Parameter=range_2, stops=[0: RGB(255, 0, 0), 0.5: RGB(255, 136, 0), 1: RGB(255, 247, 0)])
hatch_4 = DefineHatch(Curve=flatten(sqgrid.Cells), Pattern="Solid", Rotation=0, Scale=1)
swatch = ColourSwatch(SwatchColor=RGB(0, 0, 0))
area_3 = Area(Geometry=flatten(sqgrid.Cells))  # -> Area, Centroid
Y_2 = UnitY(Factor="-30")
expression = Expression(x=range, y=Slider(2, range=0..10), Expression="Round(x,y)")
concat_3 = Concatenate(FragmentA=concat, FragmentB="::legenda")
layer_2 = DefineLayer(Name=concat_3)
attributes_2 = DefineObjectAttributes(Layer=layer_2, Color=gradient_2)
attributes_3 = DefineObjectAttributes(Layer=layer_2, Color=swatch)

area_4 = Area(Geometry=sqgrid.Cells)  # -> Area, Centroid

move_2 = Move(Geometry=area_4.Centroid, Motion=Y_2)  # -> Geometry, Transform
text_2 = DefineTextObject(Text=expression, Plane=move_2.Geometry, DimensionStyle="Legenda_numere", OutputType="Text")
lng_4 = ListLength(List=text_2)
dup_3 = DuplicateData(Data=swatch, Number=lng_4, Order=True)
attributes_4 = DefineObjectAttributes(Layer=layer_2, Color=dup_3)
merge_4 = Merge(Data1=flatten(attributes), Data2=flatten(attributes_3), Data3=flatten(attributes_4), Data4=flatten(attributes_2))
merge_5 = Merge(Data1=flatten(merge_3), Data2=flatten(text), Data3=flatten(text_2), Data4=flatten(hatch_4))

deatt = DeconstructAttributes(ReferencedGeometryOrAttributes=merge_4)  # -> Keys, Values, Name, Layer, Color
bake = BakeObjects(Geometry=merge_5, Attributes=merge_4, Bake=button)
material = CreateMaterial(Diffuse=deatt.Color, Specular=RGB(255, 255, 255), Emission=RGB(0, 0, 0), Transparency=0, Shine=0)
preview = CustomPreview(Geometry=merge_5, Shader=flatten(material))
