# Grasshopper definition 05_analiza_vizibilitate_grid_2025.gh (Grasshopper 1.0.7)
# plug-ins: DeCodingSpaces, EleFront

# ---- group: marime grid analiza (recomandat 5)
marime_grid = Slider(6, range=0..10)

# ----
pipeline = GeometryPipeline(
    GroupByLayer=False,
    GroupByType=False,
    IncludeHidden=True,
    IncludeLocked=True,
    LayerFilter="analiza::contur limita analiza",
    NameFilter="*",
    SublayerFiltering=True,
    TypeFilter=4)
pipeline_2 = GeometryPipeline(
    GroupByLayer=False,
    GroupByType=False,
    IncludeHidden=True,
    IncludeLocked=True,
    LayerFilter="analiza::vizibilitate::punct",
    NameFilter="*",
    SublayerFiltering=True,
    TypeFilter=5)
pipeline_3 = GeometryPipeline(
    GroupByLayer=False,
    GroupByType=False,
    IncludeHidden=True,
    IncludeLocked=True,
    LayerFilter="propunere::Constructii",
    NameFilter="*",
    SublayerFiltering=True,
    TypeFilter=4)
# Analiză vizibilitate pe grid
# 
# Analiza vizibilitate în plan
# pe un grid aplicat pe o zona.
# 
# Script dezvoltat în cadrul proiectului
# SCHOLAR ARCHITECT 2024
# Proiect finațat prin CNFIS-FDI-2024-F-0032.
# Autori: Ionuț Anton și Ana Daniela Anton
pipeline_4 = GeometryPipeline(
    GroupByLayer=False,
    GroupByType=False,
    IncludeHidden=True,
    IncludeLocked=True,
    LayerFilter="urbanism::Constructii",
    NameFilter="*",
    SublayerFiltering=True,
    TypeFilter=4)

# ---- group: Click aici pentru bake in rhino
button = Button()

# ----
contur_analiza = Curve(pipeline)
pt = Point(pipeline_2)
crv = Curve(pipeline_3)
crv_2 = Curve(pipeline_4)
list = ValueList({"SOLID"}, selected="SOLID")
list_2 = ValueList({"SOLID"}, selected="SOLID")

merge = Merge(Data1=crv_2, Data2=crv)

merge_2 = Merge(Data1=merge, Data2=contur_analiza)
explode = Explode(Curve=merge_2, Recursive=True)  # -> flatten(Segments), Vertices
analysis_grid = AnalysisGrid(ObstacleLines=explode.Segments, CellSize=marime_grid, FillPoint=pt)  # -> AnalysisPoints, GridCells
data = Data(analysis_grid.GridCells)
isovist = Isovist(
    VantagePointS=analysis_grid.AnalysisPoints,
    ObstacleLines=explode.Segments,
    ViewingDirection=Vector(0, 1, 0),
    ViewingRange=1000,
    ViewingAngle=360,
    Precision=360,
    ShowPolygon=Toggle(False),
    ShowRadials=False,
    UseGPU=Toggle(False))  # -> IsovistPolygon, Radials, ObstacleVisibility, IsovistProperties
item = ListItem(List=isovist.IsovistProperties, Index=Slider(4, range=0..16), Wrap=True)  # -> flatten(Item)
bnd = Bounds(Numbers=item)
dedomain = DeconstructDomain(Domain=bnd)  # -> Start, End
gradient = Gradient(
    LowerLimit=dedomain.Start,
    UpperLimit=dedomain.End,
    Parameter=item,
    stops=[0: RGB(234, 38, 0), 0.25: RGB(234, 126, 0), 0.5: RGB(254, 244, 84), 0.75: RGB(173, 203, 249), 1: RGB(75, 107, 169)])
hatch = DefineHatch(Curve=merge, Pattern=list, Rotation=0, Scale=1)
hatch_2 = DefineHatch(Curve=data, Pattern=list_2, Rotation=0, Scale=1)

bbox = BoundingBox(Content=contur_analiza, Plane=PlaneXY(0, 0, 0))  # -> Box, Box_2
evalsrf = EvaluateSurface(Surface=reparameterize(bbox.Box), Point="{1,0,0}")  # -> Point, Normal, UDirection, VDirection, Frame
Y = UnitY(Factor="-100")
move = Move(Geometry=evalsrf.Point, Motion=Y)  # -> Geometry, Transform
list_3 = ValueList({"Default", "Legenda"}, selected="Legenda")
range = Range(Domain=bnd, Steps=expr("x-1", "5"))
range_2 = Range(Domain=Domain(0, 1), Steps=expr("x-1", "5"))
sqgrid = Square(Plane=move.Geometry, Size=Slider(50, range=0..100), ExtentX="5", ExtentY="1")  # -> Cells, Points
text = DefineTextObject(Text="vizibilitate_grid", Plane=evalsrf.Point, DimensionStyle=list_3, OutputType="Text")
gradient_2 = Gradient(
    LowerLimit=0,
    UpperLimit=1,
    Parameter=range_2,
    stops=[0: RGB(234, 38, 0), 0.25: RGB(234, 126, 0), 0.5: RGB(254, 244, 84), 0.75: RGB(173, 203, 249), 1: RGB(75, 107, 169)])
hatch_3 = DefineHatch(Curve=flatten(sqgrid.Cells), Pattern="Solid", Rotation=0, Scale=1)
area = Area(Geometry=flatten(sqgrid.Cells))  # -> Area, Centroid
swatch = ColourSwatch(SwatchColor=RGB(0, 0, 0))
Y_2 = UnitY(Factor="-30")
expression = Expression(x=range, y=Slider(2, range=0..10), Expression="Round(x,y)")
move_2 = Move(Geometry=area.Centroid, Motion=Y_2)  # -> Geometry, Transform
text_2 = DefineTextObject(Text=expression, Plane=move_2.Geometry, DimensionStyle="Legenda_numere", OutputType="Text")
lng = ListLength(List=text_2)
dup = DuplicateData(Data=swatch, Number=lng, Order=True)

lng_2 = ListLength(List=hatch)
lng_3 = ListLength(List=gradient)
dup_2 = DuplicateData(Data="vizibilitate_grid", Number=lng_3, Order=True)
dup_3 = DuplicateData(Data=ColourSwatch(SwatchColor=RGB(0, 0, 0)), Number=lng_2, Order=True)
merge_3 = Merge(Data1=flatten(hatch_2), Data2=flatten(hatch))

trigger = Trigger(Interval=60000, TimerInterval=60000, Target=time)  # disabled
time = Time("now")
format = Format(Format="{0:yyyy-MM-dd-HH-mm-ss}", Culture=127, Data0=time)
concat = Concatenate(FragmentA="analiza_out::vizibilitate_grid::", FragmentB=format)

concat_2 = Concatenate(FragmentA=concat, FragmentB="::analiza")

layer = DefineLayer(Name=concat_2)

attributes = DefineObjectAttributes(UserKeys=dup_2, UserValues=item, Layer=layer, Color=gradient)
attributes_2 = DefineObjectAttributes(Layer=layer, Color=dup_3)
merge_4 = Merge(Data1=flatten(attributes), Data2=flatten(attributes_2))

concat_3 = Concatenate(FragmentA=concat, FragmentB="::legenda")
layer_2 = DefineLayer(Name=concat_3)
attributes_3 = DefineObjectAttributes(Layer=layer_2, Color=gradient_2)
attributes_4 = DefineObjectAttributes(Layer=layer_2, Color=dup)
attributes_5 = DefineObjectAttributes(Layer=layer_2, Color=swatch)
merge_5 = Merge(Data1=flatten(merge_4), Data2=flatten(attributes_5), Data3=flatten(attributes_4), Data4=flatten(attributes_3))
merge_6 = Merge(Data1=flatten(merge_3), Data2=flatten(text), Data3=flatten(text_2), Data4=flatten(hatch_3))

deatt = DeconstructAttributes(ReferencedGeometryOrAttributes=merge_5)  # -> Keys, Values, Name, Layer, Color
bake = BakeObjects(Geometry=merge_6, Attributes=merge_5, Bake=button)
material = CreateMaterial(Diffuse=deatt.Color, Specular=RGB(255, 255, 255), Emission=RGB(0, 0, 0), Transparency=0, Shine=0)
preview = CustomPreview(Geometry=merge_6, Shader=flatten(material))
