# Grasshopper definition 06_analiza_denisitate_POT_2025.gh (Grasshopper 1.0.8)
# plug-ins: eleFront

pipeline = GeometryPipeline(
    GroupByLayer=False,
    GroupByType=False,
    IncludeHidden=True,
    IncludeLocked=True,
    LayerFilter="analiza::contur limita analiza",
    NameFilter="*",
    SublayerFiltering=True,
    TypeFilter=4)
pipeline_2 = GeometryPipeline(
    GroupByLayer=False,
    GroupByType=False,
    IncludeHidden=True,
    IncludeLocked=True,
    LayerFilter="urbanism::Parcele blocuri",
    NameFilter="*",
    SublayerFiltering=True,
    TypeFilter=4)
# Analiză densitate - POT
# 
# Analiza denistate urbană -
#  procent ocupare teren.
# 
# Script dezvoltat în cadrul proiectului
# SCHOLAR ARCHITECT 2024
# Proiect finațat prin CNFIS-FDI-2024-F-0032.
# Autori: Ionuț Anton și Ana Daniela Anton
pipeline_3 = GeometryPipeline(
    GroupByLayer=False,
    GroupByType=False,
    IncludeHidden=True,
    IncludeLocked=True,
    LayerFilter="propunere::Constructii",
    NameFilter="*",
    SublayerFiltering=True,
    TypeFilter=4)
pipeline_4 = GeometryPipeline(
    GroupByLayer=False,
    GroupByType=False,
    IncludeHidden=True,
    IncludeLocked=True,
    LayerFilter="urbanism::Constructii",
    NameFilter="*",
    SublayerFiltering=True,
    TypeFilter=4)
pipeline_5 = GeometryPipeline(
    GroupByLayer=False,
    GroupByType=False,
    IncludeHidden=True,
    IncludeLocked=True,
    LayerFilter="urbanism::Parcele",
    NameFilter="*",
    SublayerFiltering=True,
    TypeFilter=4)

# ---- group: Click aici pentru bake in rhino
button = Button()

# ----
constructii = Curve(pipeline_4)
propunere = Curve(pipeline_3)
parcele = Curve(pipeline_5)
parcele_blocuri = Curve(pipeline_2)
crv = Curve(pipeline)
merge = Merge(Data1=flatten(propunere), Data2=flatten(constructii))
merge_2 = Merge(Data1=flatten(parcele), Data2=flatten(parcele_blocuri))  # -> graft(Result)
area = Area(Geometry=merge)  # -> Area, Centroid
incurve = PointInCurve(Point=area.Centroid, Curve=graft(merge_2))  # -> Relationship, Point
area_2 = Area(Geometry=graft(merge_2))  # -> Area, Centroid
equals = Equality(FirstNumber=incurve.Relationship, SecondNumber="2")  # -> Equality, Inequality
cull = CullPattern(List=area.Area, CullPattern=equals.Equality)
ma = MassAddition(Input=cull)  # -> Result, PartialResults
division = Division(A=ma.Result, B=area_2.Area)
expression = Expression(x=division, y=Slider(2, range=0..10), Expression="Round(x,y)")
bnd = Bounds(Numbers=flatten(expression))
dedomain = DeconstructDomain(Domain=bnd)  # -> Start, End
gradient = Gradient(
    LowerLimit=dedomain.Start,
    UpperLimit=dedomain.End,
    Parameter=expression,
    stops=[0: RGB(222, 196, 245), 1: RGB(119, 0, 255)])

hatch = DefineHatch(Curve=merge_2, Pattern="Solid", Rotation=0, Scale=1)  # -> graft(Hatch)

trigger = Trigger(Interval=60000, TimerInterval=60000, Target=time)
time = Time("now")
format = Format(Format="{0:yyyy-MM-dd-HH-mm-ss}", Culture=127, Data0=time)
concat = Concatenate(FragmentA="analiza_out::denistate_POT::", FragmentB=format)
concat_2 = Concatenate(FragmentA=concat, FragmentB="::analiza")

list = ValueList({"Layer", "Material", "Object", "Parent"}, selected="Object")

bbox = BoundingBox(Content=crv, Plane=PlaneXY(0, 0, 0))  # -> Box, Box_2
evalsrf = EvaluateSurface(Surface=reparameterize(bbox.Box), Point="{1,0,0}")  # -> Point, Normal, UDirection, VDirection, Frame
Y = UnitY(Factor="-100")
list_2 = ValueList({"Default", "Legenda", "Legenda_numere"}, selected="Legenda")
move = Move(Geometry=evalsrf.Point, Motion=Y)  # -> Geometry, Transform
range = Range(Domain=bnd, Steps=expr("x-1", "5"))
range_2 = Range(Domain=Domain(0, 1), Steps=expr("x-1", "5"))
sqgrid = Square(Plane=move.Geometry, Size=Slider(50, range=0..100), ExtentX="5", ExtentY="1")  # -> Cells, Points
text = DefineTextObject(Text="densitate_POT", Plane=evalsrf.Point, DimensionStyle=list_2)
hatch_2 = DefineHatch(Curve=flatten(sqgrid.Cells), Pattern="Solid", Rotation=0, Scale=1)
gradient_2 = Gradient(LowerLimit=0, UpperLimit=1, Parameter=range_2, stops=[0: RGB(222, 196, 245), 1: RGB(119, 0, 255)])
area_3 = Area(Geometry=flatten(sqgrid.Cells))  # -> Area, Centroid
expression_2 = Expression(x=range, y=Slider(2, range=0..10), Expression="Round(x,y)")
swatch = ColourSwatch(SwatchColor=RGB(0, 0, 0))
Y_2 = UnitY(Factor="-30")
concat_3 = Concatenate(FragmentA=concat, FragmentB="::legenda")
list_3 = ValueList({"Default", "Legenda", "Legenda_numere"}, selected="Legenda_numere")
move_2 = Move(Geometry=area_3.Centroid, Motion=Y_2)  # -> Geometry, Transform
ef_layer = EleFrontLayer(Layer=concat_3, fullpath=True)
text_2 = DefineTextObject(Text=expression_2, Plane=move_2.Geometry, DimensionStyle=list_3)
lng = ListLength(List=text_2)
dup = DuplicateData(Data=swatch, Number=lng, Order=True)
list_4 = ValueList({"Layer", "Material", "Object", "Parent"}, selected="Object")
list_5 = ValueList({"Layer", "Material", "Object", "Parent"}, selected="Object")
list_6 = ValueList({"Layer", "Material", "Object", "Parent"}, selected="Object")
ef_att = EleFrontAttributes(Layer=ef_layer, ColourSource=list_6, ObjectColour=swatch, maintainBakeName=False)
ef_att_2 = EleFrontAttributes(Layer=ef_layer, ColourSource=list_4, ObjectColour=dup, maintainBakeName=False)
ef_att_3 = EleFrontAttributes(Layer=ef_layer, ColourSource=list_5, ObjectColour=gradient_2, maintainBakeName=False)
merge_3 = Merge(Data1=flatten(hatch), Data2=flatten(text), Data3=flatten(text_2), Data4=flatten(hatch_2))

lng_2 = ListLength(List=expression)
dup_2 = DuplicateData(Data="densitate_POT", Number=lng_2, Order=True)
ef_layer_2 = EleFrontLayer(Layer=concat_2, fullpath=True)

attributes = EleFrontAttributes(Keys=dup_2, Values=expression, Layer=ef_layer_2, ColourSource=list, ObjectColour=gradient, maintainBakeName=False)

merge_4 = Merge(Data1=flatten(attributes), Data2=flatten(ef_att), Data3=flatten(ef_att_2), Data4=flatten(ef_att_3))

deatt = EleFrontAttributes(Attributes=merge_4, maintainBakeName=False)
bake = BakeObjects(Geometry=merge_3, Attributes=merge_4, Bake=button, createGroups=False)  # -> Message, Ghosts

material = CreateMaterial(Diffuse=deatt, Specular=RGB(255, 255, 255), Emission=RGB(0, 0, 0), Transparency=0, Shine=0)
preview = CustomPreview(Geometry=merge_3, Shader=flatten(material))
