# Grasshopper definition 08_analiza_denisitate_zona_2025.gh (Grasshopper 1.0.8)
# plug-ins: eleFront

pipeline = GeometryPipeline(
    GroupByLayer=False,
    GroupByType=False,
    IncludeHidden=True,
    IncludeLocked=True,
    LayerFilter="analiza::contur limita analiza",
    NameFilter="*",
    SublayerFiltering=True,
    TypeFilter=4)
# Analiză densitate - zona
# 
# Analiza denistate urbană folosind
# un grid de analiza pe o zonă.
# 
# Script dezvoltat în cadrul proiectului
# SCHOLAR ARCHITECT 2024
# Proiect finațat prin CNFIS-FDI-2024-F-0032.
# Autori: Ionuț Anton și Ana Daniela Anton
pipeline_2 = GeometryPipeline(
    GroupByLayer=False,
    GroupByType=False,
    IncludeHidden=True,
    IncludeLocked=True,
    LayerFilter="urbanism::Constructii",
    NameFilter="*",
    SublayerFiltering=True,
    TypeFilter=4)

# ---- group: Click aici pentru bake in rhino
button = Button()

# ----
list = ValueList({"inaltime(m)"}, selected="inaltime(m)")
bbox = BoundingBox(Content=pipeline, Plane=PlaneXY(0, 0, 0))  # -> Box, Box_2
number_slider = Slider(10, range=0..100)
getuv = GetUserValue(Geometry=pipeline_2, Key=list, detectGeometry=False)  # -> flatten(InaltimeM)
area = Area(Geometry=pipeline_2)  # -> Area, Centroid
evalsrf = EvaluateSurface(Surface=bbox.Box, Point="0,0")  # -> Point, Normal, UDirection, VDirection, Frame
dim = Dimensions(Surface=bbox.Box)  # -> UDimension, VDimension
division = Division(A=getuv, B="3")
int = Integer(division)
division_2 = Division(A=dim.UDimension, B=number_slider)
division_3 = Division(A=dim.VDimension, B=number_slider)
multiplication = Multiplication(A=int, B=area.Area)
sqgrid = Square(Plane=evalsrf.Point, Size=number_slider, ExtentX=division_2, ExtentY=division_3)  # -> flatten(Cells), Points
adc = Data(multiplication)
area_2 = Area(Geometry=sqgrid.Cells)  # -> Area, Centroid
incurve = PointInCurve(Point=area_2.Centroid, Curve=pipeline)  # -> Relationship, Point
equals = Equality(FirstNumber=incurve.Relationship, SecondNumber="2")  # -> Equality, Inequality
cull = CullPattern(List=sqgrid.Cells, CullPattern=equals.Equality)
data = Data(flatten(cull))
area_3 = Area(Geometry=data)  # -> Area, graft(Centroid)
dom = ConstructDomain(DomainStart=expr("-x/2", number_slider), DomainEnd=expr("x/2", number_slider))
dist = Distance(PointA=area.Centroid, PointB=area_3.Centroid)
rectangle = Rectangle(Plane=area_3.Centroid, XSize=dom, YSize=dom, Radius=0)  # -> Rectangle, Length
smaller = SmallerThan(FirstNumber=dist, SecondNumber=Slider(150, range=0..1000))  # -> SmallerThan, OrEqualTo
cull_2 = CullPattern(List=adc, CullPattern=smaller.SmallerThan)
ma = MassAddition(Input=cull_2)  # -> flatten(Result), PartialResults
bnd = Bounds(Numbers=ma.Result)
dedomain = DeconstructDomain(Domain=bnd)  # -> Start, End
gradient = Gradient(
    LowerLimit=dedomain.Start,
    UpperLimit=dedomain.End,
    Parameter=ma.Result,
    stops=[0: RGB(0, 128, 0), 0.5: RGB(255, 255, 0), 1: RGB(255, 0, 0)])

hatch = DefineHatch(Curve=rectangle.Rectangle, Pattern="Solid", Rotation=0, Scale=1)  # -> flatten(Hatch)
preview = CustomPreview(Geometry=hatch, Material=gradient)

trigger = Trigger(Interval=60000, TimerInterval=60000, Target=time)
time = Time("now")
format = Format(Format="{0:yyyy-MM-dd-HH-mm-ss}", Culture=127, Data0=time)
concat = Concatenate(FragmentA="analiza_out::denistate_construit::", FragmentB=format)

list_2 = ValueList({"Default", "Legenda", "Legenda_numere"}, selected="Legenda")
lng = ListLength(List=ma.Result)
list_3 = ValueList({"Default", "Legenda", "Legenda_numere"}, selected="Legenda_numere")
list_4 = ValueList({"Layer", "Material", "Object", "Parent"}, selected="Object")

bbox_2 = BoundingBox(Content=pipeline, Plane=PlaneXY(0, 0, 0))  # -> Box, Box_2
evalsrf_2 = EvaluateSurface(Surface=reparameterize(bbox_2.Box), Point="{1,0,0}")  # -> Point, Normal, UDirection, VDirection, Frame
Y = UnitY(Factor="-100")
move = Move(Geometry=evalsrf_2.Point, Motion=Y)  # -> Geometry, Transform
range = Range(Domain=bnd, Steps=expr("x-1", "5"))
range_2 = Range(Domain=Domain(0, 1), Steps=expr("x-1", "5"))
sqgrid_2 = Square(Plane=move.Geometry, Size=Slider(50, range=0..100), ExtentX="5", ExtentY="1")  # -> Cells, Points
hatch_2 = DefineHatch(Curve=flatten(sqgrid_2.Cells), Pattern="Solid", Rotation=0, Scale=1)
gradient_2 = Gradient(LowerLimit=0, UpperLimit=1, Parameter=range_2, stops=[0: RGB(0, 128, 0), 0.5: RGB(255, 255, 0), 1: RGB(255, 0, 0)])
area_4 = Area(Geometry=flatten(sqgrid_2.Cells))  # -> Area, Centroid
swatch = ColourSwatch(SwatchColor=RGB(0, 0, 0))
Y_2 = UnitY(Factor="-30")
concat_2 = Concatenate(FragmentA=concat, FragmentB="::legenda")
move_2 = Move(Geometry=area_4.Centroid, Motion=Y_2)  # -> Geometry, Transform
ef_layer = EleFrontLayer(Layer=concat_2, fullpath=True)
list_5 = ValueList({"Layer", "Material", "Object", "Parent"}, selected="Object")
list_6 = ValueList({"Layer", "Material", "Object", "Parent"}, selected="Object")
list_7 = ValueList({"Layer", "Material", "Object", "Parent"}, selected="Object")
attributes = EleFrontAttributes(Layer=ef_layer, ColourSource=list_5, ObjectColour=gradient_2, maintainBakeName=False)
attributes_2 = EleFrontAttributes(Layer=ef_layer, ColourSource=list_7, ObjectColour=swatch, maintainBakeName=False)

text = DefineTextObject(Text="densitate_zona", Plane=evalsrf_2.Point, DimensionStyle=list_2)
dup = DuplicateData(Data="densitate_zona", Number=lng, Order=True)
expression = Expression(x=range, y=Slider(2, range=0..10), Expression="Round(x,y)")

concat_3 = Concatenate(FragmentA=concat, FragmentB="::analiza")
ef_layer_2 = EleFrontLayer(Layer=concat_3, fullpath=True)
attributes_3 = EleFrontAttributes(Keys=dup, Values=ma.Result, Layer=ef_layer_2, ColourSource=list_4, ObjectColour=gradient, maintainBakeName=False)

text_2 = DefineTextObject(Text=expression, Plane=move_2.Geometry, DimensionStyle=list_3)

lng_2 = ListLength(List=text_2)
dup_2 = DuplicateData(Data=swatch, Number=lng_2, Order=True)
attributes_4 = EleFrontAttributes(Layer=ef_layer, ColourSource=list_6, ObjectColour=dup_2, maintainBakeName=False)
merge = Merge(Data1=flatten(attributes_3), Data2=flatten(attributes_2), Data3=flatten(attributes_4), Data4=flatten(attributes))
merge_2 = Merge(Data1=flatten(hatch), Data2=flatten(text), Data3=flatten(text_2), Data4=flatten(hatch_2))

deatt = EleFrontAttributes(Attributes=merge, maintainBakeName=False)
bake = BakeObjects(Geometry=merge_2, Attributes=merge, Bake=button, createGroups=False)  # -> Message, Ghosts

material = CreateMaterial(Diffuse=deatt, Specular=RGB(255, 255, 255), Emission=RGB(0, 0, 0), Transparency=0, Shine=0)
preview_2 = CustomPreview(Geometry=merge_2, Shader=flatten(material))
