# Grasshopper definition 10_analiza_umbrire_2025.gh (Grasshopper 1.0.7)
# plug-ins: EleFront

# ---- group: marime grid analiza (recomandat 5)
number_slider = Slider(3, range=0..10)

# ----
pipeline = GeometryPipeline(
    GroupByLayer=False,
    GroupByType=False,
    IncludeHidden=True,
    IncludeLocked=True,
    LayerFilter="analiza::contur limita analiza",
    NameFilter="*",
    SublayerFiltering=True,
    TypeFilter=4)
pipeline_2 = GeometryPipeline(
    GroupByLayer=False,
    GroupByType=False,
    IncludeHidden=True,
    IncludeLocked=True,
    LayerFilter="urbanism::Constructii",
    NameFilter="*",
    SublayerFiltering=True,
    TypeFilter=4)
pipeline_3 = GeometryPipeline(
    GroupByLayer=False,
    GroupByType=False,
    IncludeHidden=True,
    IncludeLocked=True,
    LayerFilter="propunere::Constructii",
    NameFilter="*",
    SublayerFiltering=True,
    TypeFilter=4)

# ---- group: Selecteaza solstițiu
list = ValueList({"Solstitiu Vara": 6, "Solstitiu Iarna": 12}, selected="Solstitiu Vara")

# ---- group: Click aici pentru bake in rhino
button = Button()

# ----
# Analiză umbrire
# 
# Analiza umbrire pe planul orizontal
# si pe cladirile propuse la
# Solstițiul de Vară sau Solstițiul de Iarnă.
# 
# Script dezvoltat în cadrul proiectului
# SCHOLAR ARCHITECT 2024
# Proiect finațat prin CNFIS-FDI-2024-F-0032.
# Autori: Ionuț Anton și Ana Daniela Anton
# Import Location from EPW File
python = GhPythonScript()  # -> out, a, b
# ---------- python: Python ----------
__author__ = "ionut"
__version__ = "2024.10.09"

import rhinoscriptsyntax as rs
import os

a = ghdoc.Path
# Get the directory of the given file path
folder_path = os.path.dirname(a)

# Define the subfolder and file to append
subfolder_file = r'installs\ROU_Bucharest.154200_IWEC\ROU_Bucharest.154200_IWEC.epw'

# Create the new file path by joining the folder path and subfolder_file
b = os.path.join(folder_path, subfolder_file)
# ---------- end python ----------
importloc = LBImportLocation(epw_file=python.b)  # -> location; plug-in component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

# ----
# Analysis Period for
# Summer Solstice
panel = Panel("4")
panel_2 = Panel(list)
analysisperiod = LBAnalysisPeriod(start_month=panel_2, start_day="21", start_hour=0, end_month=panel_2, end_day="21", timestep=panel)  # -> period, hoys, dates; plug-in component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

# ----
# Create Sunpath
panel_3 = Panel("0")
sunpath = LBSunPath(north=panel_3, location=importloc, hoys=analysisperiod.hoys, scale=1)  # -> report, vectors, altitudes, azimuths, hoys, sun_pts, analemma, daily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; plug-in component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

# ---- group: Run Me!
toggle = BooleanToggle(True)

# ----
division = Division(A=list, B=6)
time = Time("now")
filter = StreamFilter(Gate=expr("x-1", division), Stream0="Solstitiu_Vara::", Stream1="Solstitiu_Iarna::")
format = Format(Format="{0:yyyy-MM-dd-HH-mm-ss}", Culture=127, Data0=time)
concat = Concatenate(FragmentA="analiza_out::umbrire::", FragmentB=filter)
concat_2 = Concatenate(FragmentA=concat, FragmentB=format)
concat_3 = Concatenate(FragmentA=concat_2, FragmentB="::analiza")
concat_4 = Concatenate(FragmentA=concat_2, FragmentB="::cladiri_3d")
layer = DefineLayer(Name=concat_3)
layer_2 = DefineLayer(Name=concat_4)

merge = Merge(Data1=pipeline_3, Data2=pipeline_2)
list_2 = ValueList({"inaltime(m)"}, selected="inaltime(m)")
getuv = GetUserValue(Geometry=merge, Key=list_2)
Z = UnitZ(Factor=getuv)
extr = Extrude(Base=merge, Direction=Z)
boundary = BoundarySurfaces(Edges=pipeline)
clean = CleanTree(RemoveNulls=True, RemoveInvalid=True, RemoveEmpty=False, Tree=extr)
cap = CapHoles(Brep=clean)

clean_2 = CleanTree(RemoveNulls=True, RemoveInvalid=True, RemoveEmpty=False, Tree=cap)

# ----
# Run Direct Sun Study
geo = Geometry(boundary)
geo_2 = Geometry(clean_2)
panel_4 = Panel(number_slider)
directsunhours = LBDirectSunHours(
    vectors=flatten(sunpath.vectors),
    timestep=panel,
    geometry=flatten(geo),
    context=flatten(geo_2),
    grid_size=panel_4,
    offset_dist="0.1",
    run=toggle)  # -> report, points, results, mesh, legend, title, int_mtx; plug-in component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

faceb = FaceBoundaries(Mesh=directsunhours.mesh)  # -> graft(Boundaries)
bnd = Bounds(Numbers=flatten(directsunhours.results))
dedomain = DeconstructDomain(Domain=bnd)  # -> Start, End
gradient = Gradient(
    LowerLimit=dedomain.Start,
    UpperLimit=dedomain.End,
    Parameter=directsunhours.results,
    stops=[0: RGB(25, 0, 255), 0.5: RGB(255, 0, 0), 1: RGB(255, 255, 0)])
hatch = DefineHatch(Curve=faceb, Pattern="Solid", Rotation=0, Scale=1)  # -> flatten(Hatch)
lng = ListLength(List=clean_2)
dup = DuplicateData(Data=ColourSwatch(SwatchColor=RGB(46, 46, 46)), Number=lng, Order=True)

bbox = BoundingBox(Content=pipeline, Plane=PlaneXY(0, 0, 0))  # -> Box, Box_2
evalsrf = EvaluateSurface(Surface=reparameterize(bbox.Box), Point="{1,0,0}")  # -> Point, Normal, UDirection, VDirection, Frame
Y = UnitY(Factor="-100")
move = Move(Geometry=evalsrf.Point, Motion=Y)  # -> Geometry, Transform
list_3 = ValueList({"Default", "Legenda"}, selected="Legenda")
range = Range(Domain=bnd, Steps=expr("x-1", "5"))
range_2 = Range(Domain=Domain(0, 1), Steps=expr("x-1", "5"))
sqgrid = Square(Plane=move.Geometry, Size=Slider(50, range=0..100), ExtentX="5", ExtentY="1")  # -> Cells, Points
text = DefineTextObject(Text="umbrire", Plane=evalsrf.Point, DimensionStyle=list_3, OutputType="Text")
gradient_2 = Gradient(LowerLimit=0, UpperLimit=1, Parameter=range_2, stops=[0: RGB(25, 0, 255), 0.5: RGB(255, 0, 0), 1: RGB(255, 255, 0)])
hatch_2 = DefineHatch(Curve=flatten(sqgrid.Cells), Pattern="Solid", Rotation=0, Scale=1)
area = Area(Geometry=flatten(sqgrid.Cells))  # -> Area, Centroid
swatch = ColourSwatch(SwatchColor=RGB(0, 0, 0))
Y_2 = UnitY(Factor="-30")
expression = Expression(x=range, y=Slider(2, range=0..10), Expression="Round(x,y)")
concat_5 = Concatenate(FragmentA=concat_2, FragmentB="::legenda")
move_2 = Move(Geometry=area.Centroid, Motion=Y_2)  # -> Geometry, Transform
layer_3 = DefineLayer(Name=concat_5)
text_2 = DefineTextObject(Text=expression, Plane=move_2.Geometry, DimensionStyle="Legenda_numere", OutputType="Text")
lng_2 = ListLength(List=text_2)
dup_2 = DuplicateData(Data=swatch, Number=lng_2, Order=True)
attributes = DefineObjectAttributes(Layer=layer_3, Color=gradient_2)
attributes_2 = DefineObjectAttributes(Layer=layer_3, Color=dup_2)
attributes_3 = DefineObjectAttributes(Layer=layer_3, Color=swatch)

lng_3 = ListLength(List=directsunhours.results)
dup_3 = DuplicateData(Data="umbrire", Number=lng_3, Order=True)
attributes_4 = DefineObjectAttributes(UserKeys=dup_3, UserValues=directsunhours.results, Layer=layer, Color=gradient)
attributes_5 = DefineObjectAttributes(Layer=layer_2, Color=dup)
merge_2 = Merge(Data1=flatten(attributes_4), Data2=flatten(attributes_5))
merge_3 = Merge(Data1=flatten(hatch), Data2=flatten(clean_2))

merge_4 = Merge(Data1=flatten(merge_2), Data2=flatten(attributes_3), Data3=flatten(attributes_2), Data4=flatten(attributes))
merge_5 = Merge(Data1=flatten(merge_3), Data2=flatten(text), Data3=flatten(text_2), Data4=flatten(hatch_2))

deatt = DeconstructAttributes(ReferencedGeometryOrAttributes=merge_4)  # -> Keys, Values, Name, Layer, Color
bake = BakeObjects(Geometry=merge_5, Attributes=merge_4, Bake=button)
material = CreateMaterial(Diffuse=deatt.Color, Specular=RGB(255, 255, 255), Emission=RGB(0, 0, 0), Transparency=0, Shine=0)
preview = CustomPreview(Geometry=merge_5, Shader=flatten(material))
